# Grasshopper definition GH_Cup.ghx (Grasshopper 1.0.7)
# plug-ins: Speckle 2, TT Toolbox

# ----
# Etape 3:
# Julia a fait l'optimisation et renvoie les paramètres correspondant à GH
# (via un fichier d'échange)
panel = Panel("D:/2022/FIATLUX_Implementation/NotebooksPluto/ToyExampleV1/optimizedDataForGH.csv")
toggle = BooleanToggle(True)
path = FilePath(panel)
readxl = ReadExcelSheet(Run=toggle, FilePath=path, Worksheet="1", Listen=toggle)  # -> UserMessages, Columns, Rows
panel_2 = Panel(readxl.Rows)
radius = ListItem(List=readxl.Rows, Index=Slider(1, range=1..5), Wrap=True)

panel_3 = Panel(radius)
height = ListItem(List=readxl.Rows, Index=Slider(2, range=0..5), Wrap=True)

# ----
# Etape 1:
# ToyExampleV1
# Les données créées par le client
# via un script python intégré dans un
# notebook julia sont reçues
# (via Speckle) dans Grasshopper
panel_4 = Panel("https://speckle.xyz/streams/834e9dc3f1/")
receive = Receive(
    Stream=panel_4,
    AutoReceive=True,
    CurrentComponentState="up_to_date",
    ExpandOutput=True,
    LastInfoMessage="Jean-Pierre Brasile @ 2022-07-08T07:04:17.187Z: Automatic commit created the python starter example (id:2fa9e6e28b)",
    ReceiveOnOpen=False,
    ReceivedCommitId="2fa9e6e28b",
    StreamWrapper="https://speckle.xyz/streams/834e9dc3f1",
    selectedKitName="Objects")  # -> Info, DataFromClient, Épaisseur, Point, Units, Volume
pt = Point(receive.Point)

panel_5 = Panel(receive.Volume)

# ----
# Etape 5:
# Envoi via Speckle de l'objet 3D
# (id du stream automatiquement créé)
# cet id est à transmettre à qui doit récupérer l'objet). Par exemple le client de la requête initiale)
# Etape 4:
# Modélisation paramétrique du verre
height_2 = Slider(100, range=0..200)
pt_2 = Point(Point(0, 0, 0))
thickness = Slider(8, range=0..20)
Z = UnitZ(Factor=height)
move = Move(Geometry=pt_2, Motion=Z)  # -> Geometry, Transform
r_z_h = Circle(Plane=move.Geometry, Radius=panel_3)
r_z_0 = Circle(Plane=pt_2, Radius=panel_3)
boundary = BoundarySurfaces(Edges=r_z_0)
list = Accounts(
    {"No account selected": , "Account (jp.brasile@gmail.com | https://speckle.xyz)": "b416f52ba5"}, selected="Account (jp.brasile@gmail.com | https://speckle.xyz)",
    selectedId="b416f52ba5",
    selectedServer="https://speckle.xyz")
id_19bbef82bc = CreateStream(Account=list, stream="19bbef82bc https://speckle.xyz b416f52ba5")
receive_2 = Receive(
    Stream=id_19bbef82bc,
    AutoReceive=True,
    CurrentComponentState="up_to_date",
    ExpandOutput=True,
    LastInfoMessage="Jean-Pierre Brasile @ 2022-07-08T09:00:32.905Z: Pushed 3 elements from Grasshopper. (id:77938f8933)",
    ReceiveOnOpen=False,
    ReceivedCommitId="77938f8933",
    StreamWrapper="https://speckle.xyz/streams/19bbef82bc?u=b416f52ba5",
    selectedKitName="Objects")  # -> Info, Data; disabled
panel_6 = Panel(id_19bbef82bc)
panel_7 = Panel(receive_2.Data)

# ----
# Etape 2
# Le panel enregistre les données sous
# ReceiveFromClient.csv pour prise en compte par Julia
num = Number(receive.Épaisseur)

panel_8 = Panel(num)

Z_2 = UnitZ(Factor=num)
move_z_e = Move(Geometry=pt_2, Motion=Z_2)  # -> Geometry, Transform
subtraction = Subtraction(A=panel_3, B=num)
subtraction_2 = Subtraction(A=panel_3, B=num)
r_e_z_h = Circle(Plane=move.Geometry, Radius=subtraction_2)
cir = Circle(Plane=move_z_e.Geometry, Radius=subtraction)
loft = Loft(
    Curves=[r_z_0, r_z_h, r_e_z_h, cir],
    Options={Adjust=False, Closed=False, LoftEnds=0, LoftSimp=0, LoftType=3, Rebuild=10, Refit=0.01})
boundary_2 = BoundarySurfaces(Edges=cir)
join = BrepJoin(Breps=[loft, boundary, boundary_2])  # -> Breps, Closed
send = Send(
    Stream=id_19bbef82bc,
    Data=join.Breps,
    AutoSend=True,
    BaseId="84d6088170d2299d8815add0eecc40b9",
    CurrentComponentState="up_to_date",
    KitName="Objects",
    OutputWrappers="https://speckle.xyz\t19bbef82bc\t77938f8933",
    UseDefaultCache=True,
    selectedKitName="Objects")

panel_9 = Panel(["\"data received from client\"", panel_8, panel_5])

# ----
# Juste pour test
# Envoi de données client via speckle
# (Id automatiquement créé)
id_19bbef82bc_2 = CreateStream(Account=list, stream="19bbef82bc https://speckle.xyz b416f52ba5")
send_2 = Send(
    Stream=id_19bbef82bc_2,
    Data=panel_9,
    AutoSend=True,
    BaseId="3b3b4275d724ea1acb558886e29c3a90",
    CurrentComponentState="up_to_date",
    KitName="Objects",
    OutputWrappers="https://speckle.xyz\t19bbef82bc\t6b78adf46c",
    UseDefaultCache=True,
    selectedKitName="Objects")
panel_10 = Panel(send_2)
