# Grasshopper definition GH_Cup.ghx (Grasshopper 1.0.7)
# plug-ins: Speckle 2

top_radius = Slider(73, range=0..100)
bottom_radius = Slider(64, range=0..100)
thickness = Slider(8, range=0..20)
height = Slider(100, range=0..200)
pt = Point(Point(0, 0, 0))
panel = Panel(top_radius)
Z = UnitZ(Factor=height)
Z_2 = UnitZ(Factor=thickness)
move = Move(Geometry=pt, Motion=Z)  # -> Geometry, Transform
subtraction = Subtraction(A=panel, B=thickness)
move_2 = Move(Geometry=pt, Motion=Z_2)  # -> Geometry, Transform
subtraction_2 = Subtraction(A=top_radius, B=thickness)
cir = Circle(Plane=move.Geometry, Radius=subtraction_2)
cir_2 = Circle(Plane=move.Geometry, Radius=top_radius)
cir_3 = Circle(Plane=pt, Radius=panel)
cir_4 = Circle(Plane=move_2.Geometry, Radius=subtraction)
boundary = BoundarySurfaces(Edges=cir_3)
loft = Loft(
    Curves=[cir_3, cir_2, cir, cir_4],
    Options={Adjust=False, Closed=False, LoftEnds=0, LoftSimp=0, LoftType=3, Rebuild=10, Refit=0.01})
boundary_2 = BoundarySurfaces(Edges=cir_4)
list = Accounts(
    {"No account selected": , "Account (jp.brasile@gmail.com | https://speckle.xyz)": "b416f52ba5"}, selected="Account (jp.brasile@gmail.com | https://speckle.xyz)",
    selectedId="b416f52ba5",
    selectedServer="https://speckle.xyz")
join = BrepJoin(Breps=[loft, boundary, boundary_2])  # -> Breps, Closed
id_19bbef82bc = CreateStream(Account=list, stream="19bbef82bc https://speckle.xyz b416f52ba5")
send = Send(
    Stream=id_19bbef82bc,
    Data=join.Breps,
    AutoSend=False,
    BaseId="edc992682aa89f7b3b83facc7b4750db",
    CurrentComponentState="up_to_date",
    KitName="Objects",
    OutputWrappers="https://speckle.xyz\t19bbef82bc\t153af5ae21",
    UseDefaultCache=True,
    selectedKitName="Objects")
receive = Receive(
    Stream=id_19bbef82bc,
    AutoReceive=False,
    CurrentComponentState="up_to_date",
    ExpandOutput=True,
    LastInfoMessage="Jean-Pierre Brasile @ 2022-06-30T11:48:46.778Z: Pushed 3 elements from Grasshopper. (id:153af5ae21)",
    ReceiveOnOpen=False,
    ReceivedCommitId="153af5ae21",
    StreamWrapper="https://speckle.xyz/streams/19bbef82bc?u=b416f52ba5",
    selectedKitName="Objects")  # -> Info, Data
panel_2 = Panel(id_19bbef82bc)
panel_3 = Panel(receive.Data)

# ----
# SimpleExample
# Receiving data created with python script
# 02_create_and_send.py
panel_4 = Panel("https://speckle.xyz/streams/834e9dc3f1/")
sget = StreamGet(StreamIDURL=panel_4)
receive_2 = Receive(
    Stream=panel_4,
    AutoReceive=False,
    CurrentComponentState="up_to_date",
    ExpandOutput=True,
    LastInfoMessage="Jean-Pierre Brasile @ 2022-07-01T09:07:21.611Z: Automatic commit created the python starter example (id:eab1a1f50f)",
    ReceiveOnOpen=False,
    ReceivedCommitId="eab1a1f50f",
    StreamWrapper="https://speckle.xyz/streams/834e9dc3f1",
    selectedKitName="Objects")  # -> Info, MyNumberProp, MySpeckleProp, MyTextProp, Units
pt_2 = Point(receive_2.MySpeckleProp)
panel_5 = Panel(receive_2.MyNumberProp)
