# Grasshopper definition GH_Cup.ghx (Grasshopper 1.0.7)
# plug-ins: Speckle 2

top_radius = Slider(40, range=0..100)
bottom_radius = Slider(64, range=0..100)
thickness = Slider(8, range=0..20)
height = Slider(100, range=0..200)
pt = Point(Point(0, 0, 0))
Z = UnitZ(Factor=thickness)
Z_2 = UnitZ(Factor=height)
move = Move(Geometry=pt, Motion=Z_2)  # -> Geometry, Transform
subtraction = Subtraction(A=top_radius, B=thickness)
subtraction_2 = Subtraction(A=top_radius, B=thickness)
move_2 = Move(Geometry=pt, Motion=Z)  # -> Geometry, Transform
cir = Circle(Plane=move.Geometry, Radius=subtraction_2)
cir_2 = Circle(Plane=move.Geometry, Radius=top_radius)
cir_3 = Circle(Plane=pt, Radius=top_radius)
cir_4 = Circle(Plane=move_2.Geometry, Radius=subtraction)
boundary = BoundarySurfaces(Edges=cir_3)
loft = Loft(
    Curves=[cir_3, cir_2, cir, cir_4],
    Options={Adjust=False, Closed=False, LoftEnds=0, LoftSimp=0, LoftType=3, Rebuild=10, Refit=0.01})
boundary_2 = BoundarySurfaces(Edges=cir_4)
list = Accounts(
    {"No account selected": , "Account (jp.brasile@gmail.com | https://speckle.xyz)": "b416f52ba5"}, selected="Account (jp.brasile@gmail.com | https://speckle.xyz)",
    selectedId="b416f52ba5",
    selectedServer="https://speckle.xyz")
join = BrepJoin(Breps=[loft, boundary, boundary_2])  # -> Breps, Closed
id_19bbef82bc = CreateStream(Account=list, stream="19bbef82bc https://speckle.xyz b416f52ba5")
send = Send(
    Stream=id_19bbef82bc,
    Data=join.Breps,
    AutoSend=True,
    BaseId="2bae280a69089236f8084cd4c2f4c7f2",
    CurrentComponentState="up_to_date",
    KitName="Objects",
    OutputWrappers="https://speckle.xyz\t19bbef82bc\tf7b655dad8",
    UseDefaultCache=True,
    selectedKitName="Objects")
receive = Receive(
    Stream=id_19bbef82bc,
    AutoReceive=True,
    CurrentComponentState="up_to_date",
    ExpandOutput=True,
    LastInfoMessage="Jean-Pierre Brasile @ 2022-07-06T08:38:27.097Z: Pushed 3 elements from Grasshopper. (id:f7b655dad8)",
    ReceiveOnOpen=False,
    ReceivedCommitId="f7b655dad8",
    StreamWrapper="https://speckle.xyz/streams/19bbef82bc?u=b416f52ba5",
    selectedKitName="Objects")  # -> Info, Data
panel = Panel(id_19bbef82bc)
panel_2 = Panel(receive.Data)
