# Grasshopper definition ToyExampleV2.ghx (Grasshopper 1.0.7)
# plug-ins: Speckle 2

e = Slider(1.641, range=0.1..5)
R = Slider(3, range=0..10)
H = Slider(10, range=0..20)
origin = Slider(0, range=0..5)
subtraction = Subtraction(A=R, B=e)
vec = VectorXYZ(XComponent=R, YComponent=origin, ZComponent=origin)  # -> Vector, Length
vec_2 = VectorXYZ(XComponent=origin, YComponent=origin, ZComponent=origin)  # -> Vector, Length
vec_3 = VectorXYZ(XComponent=R, YComponent=H, ZComponent=origin)  # -> Vector, Length
vec_4 = VectorXYZ(XComponent=subtraction, YComponent=e, ZComponent=origin)  # -> Vector, Length
vec_5 = VectorXYZ(XComponent=subtraction, YComponent=H, ZComponent=origin)  # -> Vector, Length
vec_6 = VectorXYZ(XComponent=origin, YComponent=e, ZComponent=origin)  # -> Vector, Length
Y = UnitY(Factor=1)
r_e_e = Point(vec_4.Vector)
point = Point(vec_6.Vector)
point_2 = Point(vec_3.Vector)
origin_2 = Point(vec_2.Vector)
point_3 = Point(vec.Vector)
r_e_h = Point(vec_5.Vector)
_0_1_0 = Point(Y)
ln = Line(StartPoint=origin_2, EndPoint=point_3)
pline = PolyLine(Vertices=[point_3, point_2, r_e_h, r_e_e, point], Closed=False)
ln_2 = Line(StartPoint=origin_2, EndPoint=_0_1_0)
line = Line()
panel = Panel(ln)
revsrf = Revolution(Curve=pline, Axis=ln_2, Domain=Domain(0, 6.283185307))
panel_2 = Panel(pline)

# ----
# Envoi via Speckle de l'objet 3D
# (id du stream automatiquement créé)
# cet id est à transmettre à qui doit récupérer l'objet). Par exemple le client de la requête initiale)
# Modélisation paramétrique du verre
# Réception des données produite par le script julia (stream 36b6a4554d)
panel_3 = Panel("https://speckle.xyz/streams/5cd63d05d1")
receive = Receive(
    Stream=panel_3,
    AutoReceive=False,
    CurrentComponentState="expired",
    ExpandOutput=True,
    LastInfoMessage="Jean-Pierre Brasile @ 2022-07-19T16:04:45.987Z: result of optimization (id:8a8d92807e)",
    ReceiveOnOpen=False,
    ReceivedCommitId="8a8d92807e",
    StreamWrapper="https://speckle.xyz/streams/5cd63d05d1",
    selectedKitName="Objects")  # -> Info, Height, Radius, Thickness, Units
pt = Point(Point(0, 0, 0))

receive_2 = Receive(
    Stream=panel_3,
    AutoReceive=False,
    CurrentComponentState="expired",
    ExpandOutput=True,
    LastInfoMessage="Jean-Pierre Brasile @ 2022-07-19T16:04:45.987Z: result of optimization (id:8a8d92807e)",
    ReceiveOnOpen=False,
    ReceivedCommitId="8a8d92807e",
    StreamWrapper="https://speckle.xyz/streams/5cd63d05d1",
    selectedKitName="Objects")  # -> Info, Height, Radius, Thickness, Units
num = Number(receive.Thickness)
panel_4 = Panel([receive.Height, receive.Radius, receive.Thickness])
num_2 = Number(receive.Height)
num_3 = Number(receive.Radius)

subtraction_2 = Subtraction(A=num_3, B=num)
Z = UnitZ(Factor=num)
height = ListItem(List=num_2, Index=num, Wrap=True)
Z_2 = UnitZ(Factor=height)
point_z_e = Move(Geometry=pt, Motion=Z)  # -> Geometry, Transform
point_à_z = Move(Geometry=pt, Motion=Z_2)  # -> Geometry, Transform
cercle_r_z_0 = Circle(Plane=pt, Radius=num_3)
cercle_r_e_z_e = Circle(Plane=point_z_e.Geometry, Radius=subtraction_2)
r_z_h = Circle(Plane=point_à_z.Geometry, Radius=num_3)
cercle_z_r_e = Circle(Plane=point_à_z.Geometry, Radius=subtraction_2)
boundary = BoundarySurfaces(Edges=cercle_r_e_z_e)
loft = Loft(
    Curves=[cercle_z_r_e, cercle_r_e_z_e],
    Options={Adjust=False, Closed=False, LoftEnds=0, LoftSimp=0, LoftType=3, Rebuild=10, Refit=0.01})
boundary_2 = BoundarySurfaces(Edges=cercle_r_z_0)
loft_2 = Loft(
    Curves=[r_z_h, cercle_z_r_e],
    Options={Adjust=False, Closed=False, LoftEnds=0, LoftSimp=0, LoftType=3, Rebuild=10, Refit=0.01})
loft_3 = Loft(
    Curves=[r_z_h, cercle_r_z_0],
    Options={Adjust=False, Closed=False, LoftEnds=0, LoftSimp=0, LoftType=3, Rebuild=10, Refit=0.01})
join = BrepJoin(Breps=[loft, boundary, boundary_2, loft_3, loft_2])  # -> Breps, Closed
send = Send(
    Stream="https://speckle.xyz/streams/c9b24bc2de",
    Data=join.Breps,
    AutoSend=False,
    BaseId="7da1848cfc88544279bae729a2be5605",
    CurrentComponentState="up_to_date",
    KitName="Objects",
    OutputWrappers="https://speckle.xyz\tc9b24bc2de\t11a4ee0eb1",
    UseDefaultCache=True,
    selectedKitName="Objects")
panel_5 = Panel(send)
