# Grasshopper definition ToyExampleV3.ghx (Grasshopper 1.0.7)
# plug-ins: Speckle 2, LunchBox

# ----
# Réception des données produite par le script julia (stream 36b6a4554d)
panel = Panel("https://speckle.xyz/streams/5cd63d05d1")
receive = Receive(
    Stream=panel,
    AutoReceive=True,
    CurrentComponentState="up_to_date",
    ExpandOutput=True,
    LastInfoMessage="Jean-Pierre Brasile @ 2022-07-23T08:37:32.563Z: result of optimization (id:35055e3644)",
    ReceiveOnOpen=False,
    ReceivedCommitId="35055e3644",
    StreamWrapper="https://speckle.xyz/streams/5cd63d05d1",
    selectedKitName="Objects")  # -> Info, E, H, Height, R, Radius, Thickness, Units, V
# New design
num = Number(receive.Thickness)
H = Slider(10, range=0..20)
R = Slider(3, range=0..10)
e = Slider(1.641, range=0.1..5)
origin = Slider(0, range=0..5)
subtraction = Subtraction(A=receive.Radius, B=num)
panel_2 = Panel([receive.Height, subtraction, num])
panel_3 = Panel("https://speckle.xyz/streams/c9b24bc2de")
vec = VectorXYZ(XComponent=receive.Radius, YComponent=origin, ZComponent=origin)  # -> Vector, Length
vec_2 = VectorXYZ(XComponent=subtraction, YComponent=num, ZComponent=origin)  # -> Vector, Length
vec_3 = VectorXYZ(XComponent=origin, YComponent=origin, ZComponent=origin)  # -> Vector, Length
vec_4 = VectorXYZ(XComponent=receive.Radius, YComponent=receive.Height, ZComponent=origin)  # -> Vector, Length
vec_5 = VectorXYZ(XComponent=subtraction, YComponent=receive.Height, ZComponent=origin)  # -> Vector, Length
Y = UnitY(Factor=1)
vec_6 = VectorXYZ(XComponent=origin, YComponent=num, ZComponent=origin)  # -> Vector, Length
r_e_e = Point(vec_2.Vector)
point = Point(vec_6.Vector)
point_2 = Point(vec_4.Vector)
origin_2 = Point(vec_3.Vector)
point_3 = Point(vec.Vector)
r_e_h = Point(vec_5.Vector)
_0_1_0 = Point(Y)
panel_4 = Panel(r_e_h)
ln = Line(StartPoint=origin_2, EndPoint=_0_1_0)
ln_2 = Line(StartPoint=origin_2, EndPoint=point_3)
pline = PolyLine(Vertices=[origin_2, point_3, point_2, r_e_h], Closed=False)
revsrf = Revolution(Curve=pline, Axis=ln, Domain=Domain(0, 6.283185307))
panel_5 = Panel(ln_2)
send = Send(
    Stream=panel_3,
    Data=revsrf,
    AutoSend=True,
    BaseId="d1f48f77300945505a25e0dc4aa8a4e1",
    CurrentComponentState="up_to_date",
    KitName="Objects",
    OutputWrappers="https://speckle.xyz\tc9b24bc2de\t8570360aa7",
    UseDefaultCache=True,
    selectedKitName="Objects")

panel_6 = Panel("""height
radius""")
pt = Point(Point(0, 0, 0))
csokv = CreateSpeckleObjectByKeyValue(Keys=panel_6, Values=[receive.Height, receive.Radius], selectedKitName="Objects")
sok = SpeckleObjectKeys(SpeckleObject=csokv, perObject=True)
send_2 = Send(
    Stream=panel_3,
    Data=csokv,
    AutoSend=False,
    BaseId="c84956ac892a375254e7441bf21012f7",
    CurrentComponentState="expired",
    KitName="Objects",
    OutputWrappers="https://speckle.xyz\tc9b24bc2de\t5915e0bd86",
    UseDefaultCache=True,
    selectedKitName="Objects")
num_2 = Number()
# Modélisation paramétrique du verre
Z = UnitZ(Factor=num_2)
point_z_e = Move(Geometry=pt, Motion=Z)  # -> Geometry, Transform
num_3 = Number()
height = ListItem(List=num_3, Index=0, Wrap=True)
Z_2 = UnitZ(Factor=height)
point_à_z = Move(Geometry=pt, Motion=Z_2)  # -> Geometry, Transform
num_4 = Number()
subtraction_2 = Subtraction(A=num_4, B=num_2)
cercle_r_z_0 = Circle(Plane=pt, Radius=num_4)
cercle_r_e_z_e = Circle(Plane=point_z_e.Geometry, Radius=subtraction_2)
r_z_h = Circle(Plane=point_à_z.Geometry, Radius=num_4)
cercle_z_r_e = Circle(Plane=point_à_z.Geometry, Radius=subtraction_2)
boundary = BoundarySurfaces(Edges=cercle_r_e_z_e)
loft = Loft(
    Curves=[cercle_z_r_e, cercle_r_e_z_e],
    Options={Adjust=False, Closed=False, LoftEnds=0, LoftSimp=0, LoftType=3, Rebuild=10, Refit=0.01})
boundary_2 = BoundarySurfaces(Edges=cercle_r_z_0)
loft_2 = Loft(
    Curves=[r_z_h, cercle_z_r_e],
    Options={Adjust=False, Closed=False, LoftEnds=0, LoftSimp=0, LoftType=3, Rebuild=10, Refit=0.01})
loft_3 = Loft(
    Curves=[r_z_h, cercle_r_z_0],
    Options={Adjust=False, Closed=False, LoftEnds=0, LoftSimp=0, LoftType=3, Rebuild=10, Refit=0.01})
panel_7 = Panel(sok)
panel_8 = Panel(send_2)
# Envoi via Speckle de l'objet 3D
# (id du stream automatiquement créé)
# cet id est à transmettre à qui doit récupérer l'objet). Par exemple le client de la requête initiale)
join = BrepJoin(Breps=[loft, boundary, boundary_2, loft_3, loft_2])  # -> Breps, Closed
bake = ObjectBake(
    BakeToggle=Toggle(False),
    GeometryObjects=revsrf,
    Layer="GH_Bake",
    ObjectName="GH_Obj",
    ObjectColor=RGB(255, 255, 255),
    LayerColor=RGB(255, 255, 255))
cso = CreateSpeckleObject(A=receive.Thickness, selectedKitName="Objects")
receive_2 = Receive(
    Stream=send_2,
    AutoReceive=False,
    CurrentComponentState="expired",
    ExpandOutput=True,
    ReceiveOnOpen=False,
    ReceivedCommitId="602524a79f",
    StreamWrapper="https://speckle.xyz/streams/c9b24bc2de/commits/5915e0bd86",
    selectedKitName="Objects")  # -> Info, Data
panel_9 = Panel(csokv)
panel_10 = Panel(receive_2.Info)
sok_2 = SpeckleObjectKeys(SpeckleObject=receive_2.Data, perObject=True)
send_3 = Send(
    Data=join.Breps,
    AutoSend=False,
    BaseId="7da1848cfc88544279bae729a2be5605",
    CurrentComponentState="primed_to_send",
    KitName="Objects",
    OutputWrappers="https://speckle.xyz\tc9b24bc2de\t11a4ee0eb1",
    UseDefaultCache=True,
    selectedKitName="Objects")
panel_11 = Panel(send_3)
panel_12 = Panel(sok_2)
sovk = SpeckleObjectValueByKey(Object=receive_2.Data, Key=sok_2, selectedKitName="Objects")
panel_14 = Panel(sovk)
