# Grasshopper definition ToyExampleV4.ghx (Grasshopper 1.0.7)
# plug-ins: Speckle 2, LunchBox

# ----
# Design à partir d'une rotation de polyline
panel = Panel("https://speckle.xyz/streams/b4fdac11b9")
receive = Receive(
    Stream=panel,
    AutoReceive=True,
    CurrentComponentState="up_to_date",
    ExpandOutput=True,
    LastInfoMessage="Jean-Pierre Brasile @ 2022-07-30T15:14:29.851Z: result of optimization (id:c6ba0d9487)",
    ReceiveOnOpen=False,
    ReceivedCommitId="c6ba0d9487",
    StreamWrapper="https://speckle.xyz/streams/b4fdac11b9",
    selectedKitName="Objects")  # -> Info, E, H, R, Units, V
origin = Slider(0, range=0..5)
vec = VectorXYZ(XComponent=origin, YComponent=origin, ZComponent=origin)  # -> Vector, Length
vec_2 = VectorXYZ(XComponent=receive.R, YComponent=origin, ZComponent=origin)  # -> Vector, Length
vec_3 = VectorXYZ(XComponent=receive.R, YComponent=receive.H, ZComponent=origin)  # -> Vector, Length
origin_2 = Point(vec.Vector)
Y = UnitY(Factor=1)
point = Point(vec_3.Vector)
point_2 = Point(vec_2.Vector)
_0_1_0 = Point(Y)
ln = Line(StartPoint=origin_2, EndPoint=_0_1_0)

# ----
# création, envoie et reception d'objet en GH
panel_2 = Panel("""height
radius""")
csokv = CreateSpeckleObjectByKeyValue(Keys=panel_2, Values=[receive.H, receive.R], selectedKitName="Objects")
sok = SpeckleObjectKeys(SpeckleObject=csokv, perObject=True)
# Réception des données produite par le script julia (stream 36b6a4554d)
panel_3 = Panel("https://speckle.xyz/streams/c9b24bc2de")
panel_4 = Panel(sok)
panel_5 = Panel(csokv)
send = Send(
    Stream=panel_3,
    Data=csokv,
    AutoSend=False,
    BaseId="e1cb219ad0c5841899ed7a523fc0413e",
    CurrentComponentState="expired",
    KitName="Objects",
    OutputWrappers="https://speckle.xyz\tc9b24bc2de\tbf62c201a1",
    UseDefaultCache=True,
    selectedKitName="Objects")
panel_6 = Panel(send)
receive_2 = Receive(
    Stream=send,
    AutoReceive=False,
    CurrentComponentState="expired",
    ExpandOutput=True,
    ReceiveOnOpen=False,
    ReceivedCommitId="bf62c201a1",
    StreamWrapper="https://speckle.xyz/streams/c9b24bc2de/commits/bf62c201a1",
    selectedKitName="Objects")  # -> Info, Data
panel_7 = Panel(receive_2.Info)
sok_2 = SpeckleObjectKeys(SpeckleObject=receive_2.Data, perObject=True)
sovk = SpeckleObjectValueByKey(Object=receive_2.Data, Key=sok_2, selectedKitName="Objects")
panel_8 = Panel(sok_2)
panel_9 = Panel(sovk)

panel_10 = Panel(receive.E)
num = Number(receive.E)

subtraction = Subtraction(A=receive.R, B=num)
vec_4 = VectorXYZ(XComponent=subtraction, YComponent=receive.H, ZComponent=origin)  # -> Vector, Length
vec_5 = VectorXYZ(XComponent=origin, YComponent=num, ZComponent=origin)  # -> Vector, Length
vec_6 = VectorXYZ(XComponent=subtraction, YComponent=num, ZComponent=origin)  # -> Vector, Length
r_e_h = Point(vec_4.Vector)
point_3 = Point(vec_5.Vector)
r_e_e = Point(vec_6.Vector)
pline = PolyLine(Vertices=[origin_2, point_2, point, r_e_h, r_e_e, point_3], Closed=False)
revsrf = Revolution(Curve=pline, Axis=ln, Domain=Domain(0, 6.283185307))
send_2 = Send(
    Stream="https://speckle.xyz/streams/c9b24bc2de",
    Data=revsrf,
    AutoSend=True,
    BaseId="a29ff4739bab49a64fc9a3e75b13e37e",
    CurrentComponentState="up_to_date",
    KitName="Objects",
    OutputWrappers="https://speckle.xyz\tc9b24bc2de\t13648dcc0e",
    UseDefaultCache=True,
    selectedKitName="Objects")
bake = ObjectBake(
    BakeToggle=Toggle(False),
    GeometryObjects=revsrf,
    Layer="GH_Bake",
    ObjectName="GH_Obj",
    ObjectColor=RGB(255, 255, 255),
    LayerColor=RGB(255, 255, 255))
panel_11 = Panel(send_2)
