# Grasshopper definition SpeckleSendReceived.gh (Grasshopper 1.0.7)
# plug-ins: Speckle 2

cir = Circle(Plane=PlaneXY(0, 0, 0), Radius=Slider(49.195, range=0..100))
ls = LocalSender(Data="33", selectedKitName="Objects")
lr = LocalReceive(LocalDataId=ls, selectedKitName="Objects")
eso = ExpandSpeckleObject(SpeckleObject=lr, selectedKitName="Objects")
panel = Panel(eso)

# ----
# Click to "receive !" or
# right click and "receive automatically"
# Click to "send !" or right click
#  to send automatically
# Send/Receive remote
panel_2 = Panel("https://speckle.xyz/streams/84c21a2025")
panel_3 = Panel("48")
receive = Receive(
    Stream=panel_2,
    AutoReceive=False,
    CurrentComponentState="up_to_date",
    ExpandOutput=True,
    LastInfoMessage="Jean-Pierre Brasile @ 2022-06-24T12:06:12.697Z: Pushed 2 elements from Grasshopper. (id:f3f1d017dd)",
    ReceiveOnOpen=False,
    ReceivedCommitId="f3f1d017dd",
    StreamWrapper="https://speckle.xyz/streams/84c21a2025",
    selectedKitName="Objects")  # -> Info, Data
send = Send(
    Stream=panel_2,
    Data=cir,
    AutoSend=False,
    BaseId="78af39d7deb3968510cf6ceac377d84a",
    CurrentComponentState="up_to_date",
    KitName="Objects",
    OutputWrappers="https://speckle.xyz\t84c21a2025\tf3f1d017dd",
    UseDefaultCache=True,
    selectedKitName="Objects")

circle = Circle(receive.Data)

panel_4 = Panel(circle)
